# Grasshopper definition GridShellGeneration.gh (Grasshopper 1.0.7)
# plug-ins: Kangaroo2 Components, Karamba3D, Weaverbird

material_elasticity_modulus_second_dir_m = Slider(675, range=0..20000)  # "Material Elasticity Modulus (Second dir. MPa)"
material_elasticity_modulus_mpa = Slider(14000, range=0..20000)
grid_cells = Slider(10, range=-100..100)
cross_section_width = Slider(0.075, range=0..1000)
cross_section_height = Slider(0.075, range=0..1000)
live_load_kn_per_square_m_from_regulatio = Panel("0")  # "Live load (kN) - per square m (From Regulations)"
lathe_spacing = Slider(1.5, range=0.5..5)
bracing_type = ValueList({"None": 0, "Diagonal": 1, "Cross / Membrane": 2}, selected="Cross / Membrane")
axial_constraint_points = Point()
boundary_curve = Curve(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)
anchor_points = Point([Point(39.5, -2.5, 0), Point(40.5, -1.5, 0), Point(41.5, -0.5, 0), Point(42.5, 0.5, 0), Point(30.5, -2.5, 0), Point(29.5, -1.5, 0), Point(28.5, -0.5, 0), Point(27.5, 0.5, 0), Point(27.5, 9.5, 0), Point(28.5, 10.5, 0), Point(29.5, 11.5, 0), Point(30.5, 12.5, 0), Point(39.5, 12.5, 0), Point(40.5, 11.5, 0), Point(41.5, 10.5, 0), Point(42.5, 9.5, 0)])
wood_type = Panel("oak")
grid_mesh = Mesh(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)

# ---- group: Grid Generation
xy_plane = XYPlane(Origin=Point(0, 0, 0))
rotate_plane = RotatePlane(Plane=xy_plane, Angle=degrees(Slider(0, range=0..100)))
bounding_box = BoundingBox(Content=boundary_curve, Plane=rotate_plane)  # -> Box, Box_2
addition = Addition(A=lathe_spacing, B=grid_cells)
multiplication = Multiplication(A=addition, B=0.5)
multiplication_2 = Multiplication(B=multiplication)
area = Area(Geometry=bounding_box.Box)  # -> Area, Centroid
dom = ConstructDomain(DomainStart=multiplication_2, DomainEnd=expr("-x", multiplication_2))
rectangle = Rectangle(Plane=area.Centroid, XSize=dom, YSize=dom, Radius=0)  # -> Rectangle, Length
boundary = BoundarySurfaces(Edges=rectangle.Rectangle)
mplane = MeshPlane(Boundary=rectangle.Rectangle, WidthCount=addition, HeightCount=addition)  # -> Mesh, Area

# ---- group: Simulation Controls
reset = Button()
run = BooleanToggle(False)

# ---- group: Bracing determination
gate = StreamGate(Stream=grid_mesh, Gate=bracing_type)  # -> Target0, Target1, Target2
tri = Triangulate(Mesh=gate.Target1)  # -> Mesh, Count
wbstellate = WeaverbirdsStellateCumulation(MeshPolylines=gate.Target2, Distance="0")
medges = MeshEdges(Mesh=[tri.Mesh, gate.Target0, wbstellate])  # -> NakedEdges, InteriorEdges, NonManifoldEdges
hingepoints = HingePoints(Mesh=[tri.Mesh, wbstellate, gate.Target0])  # -> _1, _2, _3, _4
hinge = Hinge(
    FoldStart=hingepoints._1,
    FoldEnd=hingepoints._2,
    Tip1=hingepoints._3,
    Tip2=hingepoints._4,
    RestAngle="0",
    Strength="100")

# ----
demesh = DeconstructMesh(Mesh=grid_mesh)  # -> Vertices, Faces, Colours, Normals
Z = UnitZ(Factor=Slider(0.5, range=-100..100))
load = Load(Point=demesh.Vertices, ForceVector=Z)

warpweft = WarpWeft(Mesh=grid_mesh)  # -> Warp, Weft, NakedA, NakedB
cross_section_area = Multiplication(A=cross_section_width, B=cross_section_height)
join = JoinCurves(Curves=warpweft.Weft, Preserve=False)
join_2 = JoinCurves(Curves=warpweft.Warp, Preserve=False)
multiplication_3 = Multiplication(A=material_elasticity_modulus_mpa, B=cross_section_area)
len = Length(Curve=[join_2, join])
division = Division(A=multiplication_3, B=len)
explode = Explode(Curve=join, Recursive=True)  # -> Segments, Vertices
explode_2 = Explode(Curve=join_2, Recursive=True)  # -> Segments, Vertices
shift = ShiftList(List=explode.Segments, Shift=1, Wrap=invert(True))
shift_2 = ShiftList(List=explode_2.Segments, Shift=1, Wrap=invert(True))
short = ShortestList(ListA=explode_2.Segments, ListB=shift_2, TrimMode=2)  # -> ListA, ListB
short_2 = ShortestList(ListA=explode.Segments, ListB=shift, TrimMode=2)  # -> ListA, ListB
angle = Angle(LineA=short_2.ListA, LineB=short_2.ListB, Strength=division)
angle_2 = Angle(LineA=short.ListA, LineB=short.ListB, Strength=division)

crv_cp = CurveClosestPoint(Point=anchor_points, Curve=boundary_curve)  # -> Point, Parameter, Distance
oncurve = OnCurve(Points=anchor_points, Curve=boundary_curve, Strength=Slider(10000, range=0..10000))
anchorxyz = AnchorXYZ(Point=axial_constraint_points, X=Toggle(False), Y=Toggle(False), Z=Toggle(False), Strength=Slider(614, range=0..100000))

# ---- group: Redundancies
floor = Floor(Strength=1)
length_line = LengthLine(Line=[medges.NakedEdges, medges.InteriorEdges], Strength=Slider(1000, range=0..1000))
show = Show(G=grid_mesh)

# ----
solver = Solver(
    GoalObjects=[load, length_line, show, angle, angle_2, anchorxyz, oncurve, hinge, floor],
    Reset=reset,
    Threshold=1e-15,
    Tolerance=0.01,
    On=run)  # -> I, V, flatten(O)

# ---- group: Geometry Trimming
mesh_to_surface = MeshToSurface(M=grid_mesh)  # disabled
Z_2 = UnitZ(Factor=50)  # disabled
laths_untrimmed = Curve(solver.O)
extr = Extrude(Base=mesh_to_surface, Direction=Z_2)  # disabled
cap = CapHoles(Brep=extr)  # disabled
shapein = ShapeInBrep(Brep=cap, Shape=laths_untrimmed)  # disabled
sort = SortList(Keys=shapein, ValuesA=laths_untrimmed)  # -> Keys, ValuesA; disabled
panel = Panel("2")  # disabled
equals = Equality(FirstNumber=sort.Keys, SecondNumber=panel)  # -> Equality, Inequality; disabled
dispatch = Dispatch(List=sort.ValuesA, DispatchPattern=equals.Equality)  # -> ListA, ListB; disabled
panel_2 = Panel("0")  # disabled
panel_3 = Panel(".5")  # disabled
trim = TrimWithBrep(Curve=dispatch.ListB, Brep=cap)  # -> Inside, Outside; disabled
laths = Curve(flatten(trim.Inside))  # disabled
extend_curve = ExtendCurve(Curve=laths, Type=panel_2, Start=panel_3, End=panel_3)  # disabled
intersection_with_plane = MeshCurve(Mesh=grid_mesh, Curve=extend_curve)  # -> flatten(Points), Faces; disabled
cullpt = CullDuplicates(Points=intersection_with_plane.Points, Tolerance=0.1, CullMode=3)  # -> Points, Indices, Valence; disabled

# ---- group: Material Definition
constant_mpa_to_kn_cm2_conversion = Panel("0.1")  # disabled
multiplication_4 = Multiplication(A=[material_elasticity_modulus_mpa, material_elasticity_modulus_second_dir_m], B=constant_mpa_to_kn_cm2_conversion)  # disabled
panel_4 = Panel("2")  # disabled
panel_5 = Panel("1")  # disabled
cull_i = CullIndex(List=multiplication_4, Indices=panel_5, Wrap=True)  # disabled
cull_i_2 = CullIndex(List=multiplication_4, Indices=panel_4, Wrap=True)  # disabled
panel_6 = Panel("wood")  # disabled
matprops = MaterialPropertiesKaramba3D(
    FamilyOfMaterial=panel_6,
    Name=wood_type,
    YoungsModulusKNCm2Dir1=cull_i,
    YoungsModulusKNCm2Dir2=cull_i_2,
    InPlaneShearModulus_kN_cm2=8076,
    InPlaneLateralContractionCoefficient=-1,
    TransverseShearModulusKNCm2Dir1=8076,
    TransverseShearModulusKNCm2Dir2=8076,
    SpecificWeight_kN_m3=78.5,
    CoefficientOfThermalExpansion1CDir1=1.2e-05,
    CoefficientOfThermalExpansion1CDir2=1.2e-05,
    TensileStrengthKNCm2Dir1=23.5,
    TensileStrengthKNCm2Dir2=23.5,
    CompressiveStrengthKNCm2Dir1=-23.5,
    CompressiveStrengthKNCm2Dir2=-23.5,
    ShearStrengthKNCm2Dir12=13.6,
    TsaiWuIntCoeff=0,
    StrengthHypothesis="MISES",
    mode="Orthotropic")  # disabled
matselect = MaterialSelectionKaramba3D(Materials=matprops, menu=[dropdown(1), dropdown(1)])  # disabled
cross_section = CrossSectionKaramba3D(
    FamilyNameOfCrossSection="DefaultCroSec",
    Material=matselect,
    Height_cm=expr("x*50", cross_section_width),
    UpperFlangeWidth_cm=expr("x*50", cross_section_width),
    LowerFlangeWidth_cm=expr("x*50", cross_section_width),
    mode="Trapezoid")  # disabled

# ----
llinter = LineLineIntersectionKaramba3D(Line=laths, LimitDistance_m=0.005)  # -> IntersectionPoints, LineSubSegements; disabled

# ---- group: Loads Input
live_load_per_square_meter = Multiplication(A=lathe_spacing, B=live_load_kn_per_square_m_from_regulatio)  # disabled
neg = Negative(Value=live_load_per_square_meter)  # disabled
loads = LoadsKaramba3D(Vector=Vector(0, 0, -1), LCase="0", mode="Gravity")  # disabled
Z_3 = UnitZ(Factor=neg)  # disabled
loads_2 = LoadsKaramba3D(ForceVector=Z_3, Local=False, PosInd=llinter.IntersectionPoints, LCase="0", mode="Point")  # disabled
load_2 = LoadKaramba3D(flatten([loads_2, loads]))  # disabled

# ----
linetobeam = LineToBeamKaramba3D(
    Line=flatten(llinter.LineSubSegements),
    CrossSection=cross_section,
    New=True,
    Remove=True,
    LimitDistance_ft=0.005,
    Bending=True,
    SetBucklingLength=True,
    ToPolylineMaxAngle=0.03,
    ToPolylineTolerance=0.01,
    ToPolylineMaxEdgeLength=0.25)  # -> Element, Points, Info; disabled
pull = PullPoint(Point=cullpt.Points, Geometry=linetobeam.Points, ClosestOnly=True)  # -> ClosestPoint, Distance; disabled
supp = SupportKaramba3D(PosInd=pull.ClosestPoint, menu=[buttons(on, on, on, on, on, on)])  # disabled
assemble = AssembleModelKaramba3D(Elem=linetobeam.Element, Support=supp, Load=load_2, LimitDistance_ft=0.005)  # -> Model, Info, Mass_kg, CenterOfGravity, LoadCaseNames; disabled
analyze = AnalyzeKaramba3D(Model=assemble.Model)  # -> CalculatedModel, MaximumDisplacement_cm, ResultingForceOfGravity_kN, ElasticEnergyChange_kNm; disabled
modelview = ModelViewKaramba3D(Model=analyze.CalculatedModel, ResultFactors=1, ResultCase=-1)  # -> Model, DeformedMesh, DeformedAxes, DeformedModel; disabled
beamview = BeamViewKaramba3D(Model=modelview.Model)  # -> Model, MeshesOfRenderedBeams, DeformedBeamAxes, LegendColors, LegendTags; disabled
legend = Legend(Colour=beamview.LegendColors, Tags=beamview.LegendTags, LegendType=101)  # disabled

# ==== cluster MeshToSurface
M = ClusterInput()

# ---- group: Planar Mesh to Surface
mc = MeshCorners(Mesh=M, Angle=2.35619449)
pline = PolyLine(Vertices=mc, Closed=Toggle(True))
srf = Surface(pline)

# ----
srf_2 = ClusterOutput(srf)
